# Dynamo graph Speckle Convert Revit Rooms to Geometry.dyn "getRooms2" (Dynamo 2.0.4.12684)

categories = Categories(index=425)  # graph input
all_elements_of_category = ElementsOfCategory(Category=categories)
name = Room.Name(room=all_elements_of_category)
number = Room.Number(room=all_elements_of_category)
watch = Watch(number)
string = StringInput("")
eq = watch == string
filterByBoolMask = List.FilterByBoolMask(list=name, mask=eq)
flatten = List.Flatten(list=filterByBoolMask.out)
watch_2 = Watch(all_elements_of_category)
centerBoundary = Room.CenterBoundary(room=watch_2)
watch_3 = Watch(centerBoundary)
byJoinedCurves = PolyCurve.ByJoinedCurves(curves=watch_3)
firstItem = List.FirstItem(list=byJoinedCurves@@L2)
flatten_2 = List.Flatten(list=firstItem)
filterByBoolMask_2 = List.FilterByBoolMask(list=flatten_2, mask=eq)
flatten_3 = List.Flatten(list=filterByBoolMask_2.out)
removeNulls = Lists.Manage.RemoveNulls(Data=flatten_3)
deconstructPolyCurve = Geometry.Curves.DeconstructPolyCurve(polycurve=removeNulls.Cleaned)
firstItem_2 = List.FirstItem(list=deconstructPolyCurve.Points@L2)
deconstructPoint = Geometry.Points.DeconstructPoint(point=firstItem_2)
integer_slider = IntegerSlider(7, range=0..100 step 1)  # graph input
mul = deconstructPoint.Z * integer_slider
translate = Geometry.Translate(geometry=removeNulls.Cleaned, zTranslation=mul)
floor_types = FloorTypes()  # nothing selected
levels = Levels()  # nothing selected
byOutlineTypeAndLevel = Floor.ByOutlineTypeAndLevel(outline=translate, floorType=floor_types, level=levels)
removeNulls_2 = Lists.Manage.RemoveNulls(Data=byOutlineTypeAndLevel)
string_2 = StringInput("Comments")
filterByBoolMask_3 = List.FilterByBoolMask(list=number, mask=eq)
flatten_4 = List.Flatten(list=filterByBoolMask_3.out)
removeItemAtIndex = List.RemoveItemAtIndex(list=flatten_4, indices=removeNulls.Indices)
removeItemAtIndex_2 = List.RemoveItemAtIndex(list=removeItemAtIndex, indices=removeNulls_2.Indices)
setParameterByName = Element.SetParameterByName(element=removeNulls_2.Cleaned, parameterName=string_2, value=removeItemAtIndex_2)
join = Curve.Join(curve=watch_3)  # unwired: curves
