# Grasshopper definition Speckle Export CAD Rooms and Names to Speckle.ghx (Grasshopper 1.0.7)
# plug-ins: UserDataUtils, Human

# ---- group: ROOM BOUNDARY AND TEXT
# Room names should be text in a layer called ROOM_NAME
panel = Panel("ROOM_NAME")
# Room boundaries should be curves in a layer named ROOM_BOUNDARY
panel_2 = Panel("Text")
dpipeline = DynamicGeometryPipeline(
    LayerFilter=panel,
    TypeFilter=panel_2,
    NameFilter="*",
    GroupByLayer=False,
    GroupByType=False,
    IncludeHidden=True,
    IncludeLocked=True,
    enableFullPath=False,
    listenToAttributes=True)
dpipeline_2 = DynamicGeometryPipeline(
    LayerFilter="ROOM_BOUNDARY",
    TypeFilter="Curve",
    NameFilter="*",
    GroupByLayer=False,
    GroupByType=False,
    IncludeHidden=True,
    IncludeLocked=True,
    enableFullPath=False,
    listenToAttributes=True)
txtobjinfo = TextObjectInfo(TextObjects=dpipeline)  # -> Plane, Text, Size, Alignment, VerticalAlignment
deplane = DeconstructPlane(Plane=txtobjinfo.Plane)  # -> Origin, XAxis, YAxis, ZAxis
pt = Point(deplane.Origin)
incurves = PointInCurves(Point=flatten(pt), Curves=simplify(graft(dpipeline_2)))  # -> simplify(Relationship), Index, Point
equals = Equality(FirstNumber=incurves.Relationship, SecondNumber="2")  # -> Equality, Inequality
cull = CullPattern(List=simplify(pt), CullPattern=simplify(equals.Equality))
cull_2 = CullPattern(List=simplify(dpipeline), CullPattern=simplify(equals.Equality))

# ----
area = Area(Geometry=dpipeline_2)  # -> Area, Centroid
closest_points = ClosestPoints(Point=simplify(graft(area.Centroid)), Cloud=simplify(cull), Count="2")  # -> ClosestPoint, CPIndex, Distance
list_item = ListItem(List=simplify(cull_2), Index=simplify(closest_points.CPIndex), Wrap=True)

# ---- group: ROOM BOUNDARY AND TEXT (continued)
pdecon = Deconstruct(Point=closest_points.ClosestPoint)  # -> XComponent, YComponent, ZComponent
sort = SortList(Keys=simplify(pdecon.YComponent), ValuesA=simplify(list_item), ValuesA_2=simplify(closest_points.ClosestPoint))  # -> reverse(Keys), reverse(ValuesA), reverse(ValuesA_2)
item = ListItem(List=sort.ValuesA, Index=0, Wrap=True)
txtobjinfo_2 = TextObjectInfo(TextObjects=item)  # -> Plane, Text, Size, Alignment, VerticalAlignment

# ----
flatten_tree = FlattenTree(Tree=txtobjinfo_2.Text, Path="{0}")
flatten_tree_2 = FlattenTree(Tree=dpipeline_2, Path="{0}")
surface = Surface(flatten_tree_2)

create_custom_user_data = CreateCustomUserData(Room=flatten_tree)
mesh_brep = MeshBrep(
    Brep=surface,
    Settings={GridMaxCount=0, GridMinCount=16, JaggedSeams=False, MaxEdgeLength=0, MinEdgeLength=0.0001, MinTolerance=0, Refine=True, RefineAngle=0, RelativeTolerance=0.65, SimplePlanes=True, Tolerance=0})
set_user_data = SetUserData(Object=mesh_brep, UserData=create_custom_user_data)

# ----
# Send these geometries to Speckle, they are room boundaries plus room names
geometry = Geometry(set_user_data)
